# Dynamo graph Exportar Rede Epanet.dyn (Dynamo 2.13.1.3887)

categories = Categories("OST_PlumbingFixtures")
tabela_de_nós = Views("TABELA DE NÓS")
all_elements_of_category_in_view = ElementsOfCategoryInView(Category=categories, View=tabela_de_nós)
parameter_name = StringInput("FD_Código_de_Legenda")  # graph input
set_names_nodes = Python(IN[0]=all_elements_of_category_in_view, IN[1]=parameter_name)  # CPython3
# ---------- set_names_nodes.python (13 lines) ----------
# Carregar as bibliotecas DesignScript e padrão do Python
import sys
import clr
clr.AddReference('ProtoGeometry')
from Autodesk.DesignScript.Geometry import *

param_name = IN[1]
prefix = 'N'

for index,element in enumerate(IN[0]):
    element.SetParameterByName(param_name,prefix+str(index+1))
    
OUT = IN[0]
# ----------------------------------------
categories_2 = Categories("OST_PipeCurves")
tabela_de_trechos = Views("TABELA DE TRECHOS")
all_elements_of_category_in_view_2 = ElementsOfCategoryInView(Category=categories_2, View=tabela_de_trechos)
set_names_pipes = Python(IN[0]=all_elements_of_category_in_view_2, IN[1]=parameter_name)  # CPython3
# ---------- set_names_pipes.python (13 lines) ----------
# Carregar as bibliotecas DesignScript e padrão do Python
import sys
import clr
clr.AddReference('ProtoGeometry')
from Autodesk.DesignScript.Geometry import *

param_name = IN[1]
prefix = 'T'

for index,element in enumerate(IN[0]):
    element.SetParameterByName(param_name,prefix+str(index+1))
    
OUT = IN[0]
# ----------------------------------------
map_nodes_in_pipes = Python(IN[0]=set_names_nodes, IN[1]=set_names_pipes)  # CPython3
# ---------- map_nodes_in_pipes.python (101 lines) ----------
import clr
clr.AddReference('RevitServices')
from RevitServices.Persistence import DocumentManager

clr.AddReference('RevitNodes')
import Revit
clr.ImportExtensions(Revit.Elements)
clr.ImportExtensions(Revit.GeometryConversion)

clr.AddReference('RevitAPI')
from Autodesk.Revit.DB import *

# Obtém o documento ativo
doc = DocumentManager.Instance.CurrentDBDocument

def verifica_colisao(elemento1, elemento2):
    """
    Verifica se dois elementos colidem no Revit usando Dynamo.
    
    Args:
        elemento1: Primeiro elemento do Revit.
        elemento2: Segundo elemento do Revit.
        
    Returns:
        True se houver colisão, False caso contrário.
    """
    opt = Options()  # Opções para obter a geometria
    geo1 = elemento1.get_Geometry(opt)
    geo2 = elemento2.get_Geometry(opt)

    # Converter a geometria em sólidos
    solidos1 = [g for g in geo1 if isinstance(g, Solid) and g.Volume > 0]
    solidos2 = [g for g in geo2 if isinstance(g, Solid) and g.Volume > 0]

    # Verificar interseção entre os sólidos
    for s1 in solidos1:
        for s2 in solidos2:
            if BooleanOperationsUtils.ExecuteBooleanOperation(s1, s2, BooleanOperationsType.Intersect).Volume > 0:
                return True  # Colisão detectada

    # Se não encontrou sólidos, verificar interseção da Bounding Box
    bbox1 = elemento1.get_BoundingBox(None)
    bbox2 = elemento2.get_BoundingBox(None)

    if bbox1 and bbox2:
        min1, max1 = bbox1.Min, bbox1.Max
        min2, max2 = bbox2.Min, bbox2.Max
        
        # Teste de interseção das Bounding Boxes
        if (min1.X <= max2.X and max1.X >= min2.X and
            min1.Y <= max2.Y and max1.Y >= min2.Y and
            min1.Z <= max2.Z and max1.Z >= min2.Z):
            return True  # Colisão detectada na Bounding Box

    return False  # Sem colisão


def mapear_colisoes(pecas, tubos):
    """
    Mapeia tubos para as peças que colidem com eles, usando o ID real de cada elemento como identificador.

    Args:
        pecas (list): Lista de peças do Revit.
        tubos (list): Lista de tubos do Revit.

    Returns:
        dict: Dicionário onde cada chave é o ID de um tubo e o valor é uma lista 
              com os IDs das peças que colidem com ele (máximo de 2).
    """
    colisoes = {}

    for tubo in tubos:
        pecas_colidindo = []

        # Obtém o ID do tubo
        id_tubo = str(tubo.Id.IntegerValue)

        for peca in pecas:
            if verifica_colisao(peca, tubo):
                # Obtém o ID da peça
                id_peca = str(peca.Id.IntegerValue)
                pecas_colidindo.append(id_peca)

            # Se já tem duas peças colidindo, paramos a verificação para esse tubo
            if len(pecas_colidindo) == 2:
                break

        # Adiciona ao dicionário apenas se houver pelo menos uma colisão
        if pecas_colidindo:
            colisoes[id_tubo] = pecas_colidindo

    return colisoes



# Entrada do Dynamo (listas de elementos do Revit)
pecas = [UnwrapElement(e) for e in IN[0]]
tubos = [UnwrapElement(e) for e in IN[1]]

# Saída do Dynamo
OUT = mapear_colisoes(pecas, tubos)
# ----------------------------------------
watch = Watch(map_nodes_in_pipes)
template = Python()  # CPython3; unwired: IN[0]
# ---------- template.python (137 lines) ----------
# Carregar as bibliotecas DesignScript e padrão do Python
import sys
import clr
clr.AddReference('ProtoGeometry')
from Autodesk.DesignScript.Geometry import *

template = """
[TITLE]


[JUNCTIONS]
;ID              	Elev        	Demand      	Pattern         
{{}}

[RESERVOIRS]
;ID              	Head        	Pattern         

[TANKS]
;ID              	Elevation   	InitLevel   	MinLevel    	MaxLevel    	Diameter    	MinVol      	VolCurve
 N71             	48.6        	1.0000      	0.1000      	1.9000      	1000.0000   	78539.8163  	                	;

[PIPES]
;ID              	Node1           	Node2           	Length      	Diameter    	Roughness   	MinorLoss   	Status
{{}}

[PUMPS]
;ID              	Node1           	Node2           	Parameters

[VALVES]
;ID              	Node1           	Node2           	Diameter    	Type	Setting     	MinorLoss   

[TAGS]

[DEMANDS]
;Junction        	Demand      	Pattern         	Category

[STATUS]
;ID              	Status/Setting

[PATTERNS]
;ID              	Multipliers

[CURVES]
;ID              	X-Value     	Y-Value

[CONTROLS]



[RULES]



[ENERGY]
 Global Efficiency  	75.0000
 Global Price       	0
 Demand Charge      	0.0000

[EMITTERS]
;Junction        	Coefficient

[QUALITY]
;Node            	InitQual

[SOURCES]
;Node            	Type        	Quality     	Pattern

[REACTIONS]
;Type     	Pipe/Tank       	Coefficient


[REACTIONS]
 Order Bulk            	1.00
 Order Tank            	1.00
 Order Wall            	1
 Global Bulk           	0.000000
 Global Wall           	0.000000
 Limiting Potential    	0
 Roughness Correlation 	0

[MIXING]
;Tank            	Model

[TIMES]
 Duration           	0:00 
 Hydraulic Timestep 	1:00 
 Quality Timestep   	0:06 
 Pattern Timestep   	1:00 
 Pattern Start      	0:00 
 Report Timestep    	1:00 
 Report Start       	0:00 
 Start ClockTime    	0:00:00
 Statistic          	NONE

[REPORT]
 Status             	No
 Summary            	No
 Page               	0

[OPTIONS]
 Units              	LPS
 Headloss           	H-W
 Specific Gravity   	1.000000
 Viscosity          	1.000000
 Trials             	200
 Accuracy           	0.00100000
 CHECKFREQ          	10
 MAXCHECK           	10
 DAMPLIMIT          	0.00000000
 Unbalanced         	STOP
 Pattern            	1
 Demand Multiplier  	1.0000
 Emitter Exponent   	0.5000
 Quality            	NONE mg/L
 Diffusivity        	1.000000
 Tolerance          	0.01000000

[COORDINATES]
;Node            	X-Coord         	Y-Coord
{{}}

[VERTICES]
;Link            	X-Coord         	Y-Coord

[LABELS]
;X-Coord           Y-Coord          Label & Anchor Node

[BACKDROP]
 DIMENSIONS     	567053.52       	9560153.01      	567646.75       	9560631.57      
 UNITS          	None
 FILE           	
 OFFSET         	0.00            	0.00            

[END]

"""
OUT = template
# ----------------------------------------
generate_list = Python(IN[0]=template, IN[1]=map_nodes_in_pipes, IN[2]=set_names_nodes)  # CPython3
# ---------- generate_list.python (178 lines) ----------
import clr
clr.AddReference("RevitServices")
from RevitServices.Persistence import DocumentManager
clr.AddReference("RevitAPI")
from Autodesk.Revit.DB import *

template = IN[0]
map_pipes = IN[1]
nodes = IN[2]

def generate_list_node_with_elevation(nodes):
    """
    Gera uma string formatada com as informações de elevação e rugosidade das peças.

    FD_Código_de_Legenda    Elevation(Y)   FD_Vazão
     N60             	35.4000     	0.14        	                	;

    Args:
        nodes (list): Lista de peças hidrossanitárias (elementos do Dynamo).

    Returns:
        str: String formatada com os dados das peças.
    """
    linhas = []
    fator_conversao = 0.3048  # Conversão de pés para metros

    for node in nodes:
        elemento = UnwrapElement(node)  # Desembrulha o elemento do Dynamo

        # Obtém os parâmetros da peça
        codigo_legenda = elemento.LookupParameter("FD_Código_de_Legenda").AsString()
        vazao = elemento.LookupParameter("FD_Vazão").AsDouble()

        # Obtém a elevação a partir da coordenada Z do Location
        location = elemento.Location
        if isinstance(location, LocationPoint):
            elevacao = location.Point.Z * fator_conversao  # Convertendo para metros
        else:
            continue  # Se não tiver LocationPoint, ignora o elemento

        # Formata os valores para garantir alinhamento e espaçamento correto
        linha_formatada = "{:<20}\t{:<10.4f}\t{:<10.2f}\t\t\t;".format(
            codigo_legenda, elevacao, vazao
        )

        linhas.append(linha_formatada)

    return "\n".join(linhas)


def generate_list_pipes(map_pipes):
    """
    Gera uma string formatada com as informações dos tubos e suas conexões.

    FD_Código_de_Legenda    Node1   Node2   Comprimento  Diâmetro interno  FD_Rugosidade
     T3              	N46             	N60             	26.7093     	100         	140         	0.0000      	Open  	;

    Args:
        map_pipes (dict): Dicionário onde as chaves são IDs de tubos (string)
                          e os valores são listas com os IDs das peças conectadas.

    Returns:
        str: String formatada com os dados dos tubos.
    """
    doc = DocumentManager.Instance.CurrentDBDocument
    linhas = []
    fator_conversao = 0.3048  # Conversão de pés para metros

    for tubo_id, pecas_ids in map_pipes.items():
        elemento_tubo = doc.GetElement(ElementId(int(tubo_id)))  # Obtém o tubo pelo ID

        # Verifica se o elemento foi encontrado
        if not elemento_tubo:
            continue

        # Obtém o FD_Código_de_Legenda do tubo
        codigo_tubo = elemento_tubo.LookupParameter("FD_Código_de_Legenda").AsString()

        # Obtém os FD_Código_de_Legenda das peças conectadas
        codigo_pecas = []
        for peca_id in pecas_ids:
            elemento_peca = doc.GetElement(ElementId(int(peca_id)))

            # Verifica se o elemento foi encontrado
            if not elemento_peca:
                continue

            codigo_legenda_peca = elemento_peca.LookupParameter("FD_Código_de_Legenda").AsString()
            codigo_pecas.append(codigo_legenda_peca)

        # Se não houver exatamente 2 peças conectadas, ignoramos o tubo
        if len(codigo_pecas) != 2:
            continue

        # Obtém os valores usando BuiltInParameters
        comprimento = elemento_tubo.get_Parameter(BuiltInParameter.CURVE_ELEM_LENGTH).AsDouble() * fator_conversao  # Unidade segue a do modelo
        diametro = elemento_tubo.get_Parameter(BuiltInParameter.RBS_PIPE_DIAMETER_PARAM).AsDouble()  # Em unidades do modelo
        
        # Obtém o tipo do tubo e busca o FD_Rugosidade
        tipo_tubo = doc.GetElement(elemento_tubo.GetTypeId())  # Obtém o ElementType do tubo
        rugosidade = tipo_tubo.LookupParameter("FD_Rugosidade").AsDouble()

        # Formata a linha com os dados do tubo
        linha_formatada = "{:<20}\t{:<10}\t{:<10}\t{:<10.4f}\t{:<10.0f}\t{:<10.0f}\t{:<10.4f}\tOpen  	;".format(
            codigo_tubo, codigo_pecas[0], codigo_pecas[1], comprimento, diametro, rugosidade, 0.0000
        )

        linhas.append(linha_formatada)

    return "\n".join(linhas)


def generate_list_node_whit_coord(nodes):
    """
    Gera uma string formatada com os nós e suas coordenadas X e Y convertidas para metros.

    ;Node            	X-Coord         	Y-Coord
     N60             	567205.58       	9560387.76      

    Args:
        nodes (list): Lista de peças hidrossanitárias.

    Returns:
        str: String formatada com os dados dos nós.
    """
    doc = DocumentManager.Instance.CurrentDBDocument
    fator_conversao = 0.3048  # Conversão de pés para metros
    linhas = []

    for node in nodes:
        elemento = UnwrapElement(node)  # Desembrulha o elemento do Dynamo

        # Obtém os parâmetros da peça
        codigo_legenda = elemento.LookupParameter("FD_Código_de_Legenda").AsString()

        # Obtém a posição da peça
        location = elemento.Location
        if isinstance(location, LocationPoint):
            x_coord = location.Point.X * fator_conversao  # Convertendo para metros
            y_coord = location.Point.Y * fator_conversao  # Convertendo para metros
        else:
            continue  # Se não tiver LocationPoint, ignora o elemento

        # Formata a linha mantendo alinhamento e espaçamentos corretos
        linha_formatada = "{:<20}\t{:<15.2f}\t{:<15.2f}".format(
            codigo_legenda, x_coord, y_coord
        )

        linhas.append(linha_formatada)

    return "\n".join(linhas)
    

def generate_document(template, nodes, map_pipes):
    """
    Substitui os placeholders no template pelos dados gerados das peças e tubos.

    Args:
        template (str): Template base do documento.
        nodes (list): Lista de peças hidrossanitárias.
        map_pipes (dict): Dicionário de tubos e suas conexões.

    Returns:
        str: Documento final com os placeholders substituídos.
    """
    # Gerar os trechos do documento
    doc_nodes_elevations = generate_list_node_with_elevation(nodes)
    doc_pipes = generate_list_pipes(map_pipes)
    doc_nodes_coord = generate_list_node_whit_coord(nodes)

    # Substituir os placeholders no template
    doc = template.replace("{{}}", doc_nodes_elevations, 1) \
                  .replace("{{}}", doc_pipes, 1) \
                  .replace("{{}}", doc_nodes_coord, 1)

    return doc

OUT = generate_document(template, nodes, map_pipes)
# ----------------------------------------
save_file = Python(IN[0]=generate_list)  # CPython3
# ---------- save_file.python (32 lines) ----------
# Carregar as bibliotecas DesignScript e padrão do Python
import sys
import clr
clr.AddReference('ProtoGeometry')
from Autodesk.DesignScript.Geometry import *

import os

def save_to_inp_file(content, filename="rede_hidraulica.inp"):
    """
    Salva uma string em um arquivo .inp na pasta Documentos do usuário.

    Args:
        content (str): O conteúdo a ser salvo no arquivo.
        filename (str): Nome do arquivo (padrão: "rede_hidraulica.inp").

    Returns:
        str: Caminho completo do arquivo salvo.
    """
    # Obtém o caminho da pasta Documentos do usuário
    documentos_path = os.path.expanduser("~/Documents")

    # Caminho completo do arquivo
    file_path = os.path.join(documentos_path, filename)

    # Escreve a string no arquivo .inp
    with open(file_path, "w", encoding="utf-8") as file:
        file.write(content)

    return file_path  # Retorna o caminho do arquivo salvo

OUT = save_to_inp_file(IN[0])
# ----------------------------------------
