# Dynamo graph PreencherAlturasPavimentos.dyn (Dynamo 2.13.1.3887)

categories = Categories("OST_Levels")
all_elements_of_category = ElementsOfCategory(Category=categories)
string = StringInput("Nome")
python_script = Python()  # CPython3; unwired: IN[0]
# ---------- python_script.python (86 lines) ----------
# Carregar as bibliotecas DesignScript e padrão do Python
import sys
import clr
clr.AddReference('ProtoGeometry')
from Autodesk.DesignScript.Geometry import *

pav = [
    ["TAMPO - CAIXA DAGUA", 153.72],
    ["COBERTA", 150.98],
    ["ROOFTOP", 147.20],
    ["39º PAVIMENTO TIPO", 0],
    ["38º PAVIMENTO TIPO", 0],
    ["37º PAVIMENTO TIPO", 0],
    ["36º PAVIMENTO TIPO", 0],
    ["35º PAVIMENTO TIPO", 0],
    ["34º PAVIMENTO TIPO", 0],
    ["33º PAVIMENTO TIPO", 0],
    ["32º PAVIMENTO TIPO", 0],
    ["31º PAVIMENTO TIPO", 0],
    ["30º PAVIMENTO TIPO", 0],
    ["29º PAVIMENTO TIPO", 0],
    ["28º PAVIMENTO TIPO", 0],
    ["27º PAVIMENTO TIPO", 0],
    ["26º PAVIMENTO TIPO", 0],
    ["25º PAVIMENTO TIPO", 0],
    ["24º PAVIMENTO TIPO", 0],
    ["23º PAVIMENTO TIPO", 0],
    ["22º PAVIMENTO TIPO", 0],
    ["21º PAVIMENTO TIPO", 0],
    ["20º PAVIMENTO TIPO", 0],
    ["19º PAVIMENTO TIPO", 0],
    ["18º PAVIMENTO TIPO", 0],
    ["17º PAVIMENTO TIPO", 0],
    ["16º PAVIMENTO TIPO", 0],
    ["15º PAVIMENTO TIPO", 0],
    ["14º PAVIMENTO TIPO", 0],
    ["13º PAVIMENTO TIPO", 0],
    ["12º PAVIMENTO TIPO", 0],
    ["11º PAVIMENTO TIPO", 0],
    ["10º PAVIMENTO TIPO", 0],
    ["9º PAVIMENTO TIPO", 0],
    ["8º PAVIMENTO TIPO", 0],
    ["7º PAVIMENTO TIPO", 0],
    ["6º PAVIMENTO TIPO", 0],
    ["5º PAVIMENTO TIPO", 0],
    ["4º PAVIMENTO TIPO", 0],
    ["3º PAVIMENTO TIPO", 0],
    ["2º PAVIMENTO TIPO", 0],
    ["1º PAVIMENTO TIPO", 27.32],
    ["PAVTO LAZER", 23.72],
    ["3º PAVTO GARAGEM", 20.12],
    ["2º PAVTO GARAGEM", 17.06],
    ["1º PAVTO GARAGEM", 14.18],
    ["PAVTO INTERMEDIÁRIO", 11.30],
    ["TÉRREO", 8.24],
    ["SUBSOLO", 5.36]
]

# Invertendo a lista para preencher de baixo para cima
pav.reverse()

# Inicializando lista para pavimentos completos
pav_completo = []

# Variável para guardar a última altura válida
ultima_altura = None

# Definindo o pé-direito
pe_direito = 3.06

# Preenchendo as alturas faltantes
for i in range(len(pav)):
    if pav[i][1] > 0:
        ultima_altura = pav[i][1]
        pav_completo.append([pav[i][0], pav[i][1]])
    else:
        if ultima_altura is not None:
            nova_altura = ultima_altura + pe_direito
            pav_completo.append([pav[i][0], nova_altura])
            ultima_altura = nova_altura

# Revertendo a lista de volta à ordem original
pav_completo.reverse()

# Saída final
OUT = pav_completo
# ----------------------------------------
python_script_2 = Python(IN[0]=python_script)  # CPython3
# ---------- python_script_2.python (7 lines) ----------
# Carregar as bibliotecas DesignScript e padrão do Python
import sys
import clr
clr.AddReference('ProtoGeometry')
from Autodesk.DesignScript.Geometry import *

OUT = [i[0] for i in IN[0]]
# ----------------------------------------
setParameterByName = Element.SetParameterByName(element=all_elements_of_category, parameterName=string, value=python_script_2)
string_2 = StringInput("Elevação")
python_script_3 = Python(IN[0]=python_script)  # CPython3
# ---------- python_script_3.python (7 lines) ----------
# Carregar as bibliotecas DesignScript e padrão do Python
import sys
import clr
clr.AddReference('ProtoGeometry')
from Autodesk.DesignScript.Geometry import *

OUT = [i[1] for i in IN[0]]
# ----------------------------------------
setParameterByName_2 = Element.SetParameterByName(element=all_elements_of_category, parameterName=string_2, value=python_script_3)
